# Grasshopper definition mountainscene.gh (Grasshopper 0.9.80)

# ---- group: Forest
point = Point([Point(10.83386142, -34.33796722, 0), Point(10.86651539, -33.01548168, 0), Point(9.1358553, -34.06040852, 0), Point(10.57262971, -29.35823773, 0), Point(9.625664758, -30.4684725, 0), Point(10.83386142, -25.47241602, 0)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])
amount = Slider(0.3, range=0..20)
amount_2 = Slider(8.2, range=0..20)
amount_3 = Slider(20, range=0..20)
original_tree = NurbsCurve(Vertices=point, Degree=Slider(1.2, range=-10..30), Periodic=False)  # -> Curve, Length, Domain
scale = Scale(Geometry=original_tree.Curve, Center=Point(0, 0, 0), Factor=amount)  # -> Geometry, Transform
vector_xyz = VectorXYZ(XComponent=amount_2, YComponent=amount_3, ZComponent=0)  # -> Vector, Length
mountain2_1 = Move(Geometry=scale.Geometry, Motion=vector_xyz.Vector)  # -> Geometry, Transform
amount_4 = Slider(3, range=0..20)
linear_array = LinearArray(Geometry=mountain2_1.Geometry, Direction=Vector(10, 0, 0), Count=amount_4)  # -> Geometry, Transform
amount_5 = Slider(2, range=0..20)
amount_6 = Slider(2, range=0..20)
amount_7 = Slider(23, range=0..50)
amount_8 = Slider(19, range=0..20)
vector_xyz_2 = VectorXYZ(XComponent=amount_5, YComponent=amount_6, ZComponent=0)  # -> Vector, Length
vector_xyz_3 = VectorXYZ(XComponent=amount_7, YComponent=amount_8, ZComponent=0)  # -> Vector, Length
amount_9 = Slider(6.6, range=0..20)
amount_10 = Slider(-4.5, range=-5..20)
move = Move(Geometry=linear_array.Geometry, Motion=vector_xyz_3.Vector)  # -> Geometry, Transform
move_2 = Move(Geometry=linear_array.Geometry, Motion=vector_xyz_2.Vector)  # -> Geometry, Transform
amount_11 = Slider(1.8, range=0..20)
amount_12 = Slider(-2.5, range=-5..20)
scale_2 = Scale(Geometry=move.Geometry, Center=Point(0, 0, 0), Factor=0.5)  # -> Geometry, Transform
vector_xyz_4 = VectorXYZ(XComponent=amount_9, YComponent=amount_10, ZComponent=0)  # -> Vector, Length
vector_xyz_5 = VectorXYZ(XComponent=amount_11, YComponent=amount_12, ZComponent=0)  # -> Vector, Length
amount_13 = Slider(3, range=0..50)
amount_14 = Slider(2, range=0..20)
move_3 = Move(Geometry=move_2.Geometry, Motion=vector_xyz_4.Vector)  # -> Geometry, Transform
move_4 = Move(Geometry=move_2.Geometry, Motion=vector_xyz_5.Vector)  # -> Geometry, Transform
amount_15 = Slider(1.4, range=0..20)
vector_xyz_6 = VectorXYZ(XComponent=amount_13, YComponent=amount_14, ZComponent=0)  # -> Vector, Length
amount_16 = Slider(1.211, range=-5..20)
length = Slider(75, range=0..80)
length_2 = Slider(10.363, range=0..80)
move_5 = Move(Geometry=scale_2.Geometry, Motion=vector_xyz_6.Vector)  # -> Geometry, Transform
point_2 = Point([Point(240, 7.928120814, 0), Point(243.438756, 8.674924884, 0), Point(246.1961864, 8.789817818, 0), Point(249.5855279, 9.393005721, 0), Point(251.4563212, 9.823653803, 0), Point(251.7768067, 9.823653803, 0)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])
scale_3 = Scale(Geometry=move_3.Geometry, Center=Point(0, 0, 0), Factor=amount_15)  # -> Geometry, Transform
nurbs_curve = NurbsCurve(Vertices=point_2, Degree=amount_16, Periodic=False)  # -> Curve, Length, Domain
rectangle = Rectangle(Plane=PlaneXY(0, 0, 0), XSize=length, YSize=length_2, Radius=0)  # -> Rectangle, Length
merge = Merge(
    Data1=move_5.Geometry,
    Data2=scale_3.Geometry,
    Data3=move_4.Geometry,
    Data4=move_2.Geometry,
    Data5=scale_2.Geometry,
    Data6=move_3.Geometry,
    Data7=linear_array.Geometry)

# ---- group: Dream Shell
radius = Slider(1.98, range=0..50)
radius_2 = Slider(0.395, range=0..50)
radius_3 = Slider(-1.748, range=-3..50)
point_3 = Point([Point(3.693706786, 31.92194326, 0), Point(6.895498133, 39.81546496, 0), Point(24.21938708, 44.51428212, 0), Point(3.67040863, 45.72936639, 0), Point(22.08735013, 56.07031903, 0), Point(37.20046019, 58.290157, 0)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])
nurbs_curve_2 = NurbsCurve(Vertices=point_3, Degree=radius, Periodic=False)  # -> Curve, Length, Domain
vector_xyz_7 = VectorXYZ(XComponent=radius_3, YComponent=radius_2, ZComponent=0)  # -> Vector, Length
move_6 = Move(Geometry=nurbs_curve_2.Curve, Motion=vector_xyz_7.Vector)  # -> Geometry, Transform
amount_17 = Slider(80, range=0..120)
radius_4 = Slider(0.395, range=0..50)
unit_x = UnitX(Factor=amount_17)
vector_xyz_8 = VectorXYZ(XComponent=unit_x, YComponent=radius_4, ZComponent=0)  # -> Vector, Length
move_7 = Move(Geometry=move_6.Geometry, Motion=vector_xyz_8.Vector)  # -> Geometry, Transform

# ---- group: Mountain
sides = Slider(3, range=0..20)
radius_5 = Slider(22.787, range=0..50)
polygon = Polygon(Plane=PlaneXY(0, 0, 0), Radius=radius_5, Segments=sides, FilletRadius=0)  # -> Polygon, Length
amount_18 = Slider(1.29, range=0..20)
amount_19 = Slider(2.48, range=0..20)
degrees = Slider(100, range=1..360)
geometry = Geometry(polygon.Polygon)
amount_20 = Slider(0, range=0..20)
amount_21 = Slider(40.006, range=0..80)
amount_22 = Slider(4, range=0..120)
multiplication = Multiplication(A=radius_5, B=amount_18)
multiplication_2 = Multiplication(A=amount_21, B=amount_22)
rotate = Rotate(Geometry=geometry, Angle=degrees, Plane=PlaneXY(0, 0, 0))  # -> Geometry, Transform
multiplication_3 = Multiplication(A=radius_5, B=amount_19)
height = Slider(19, range=0..100)
width = Slider(75, range=0..100)
rectangle_2 = Rectangle(Plane=PlaneXY(0, 0, 0), XSize=multiplication_2, YSize=amount_20, Radius=0)  # -> Rectangle, Length
vector_xyz_9 = VectorXYZ(XComponent=multiplication_3, YComponent=multiplication, ZComponent=0)  # -> Vector, Length
radius_6 = Slider(0, range=0..50)
unit_x_2 = UnitX(Factor=rectangle_2.Rectangle)
rectangle_3 = Rectangle(Plane=PlaneXY(0, 0, 0), XSize=width, YSize=height, Radius=0)  # -> Rectangle, Length
big_mountain = Move(Geometry=rotate.Geometry, Motion=vector_xyz_9.Vector)  # -> Geometry, Transform
vector_xyz_10 = VectorXYZ(XComponent=unit_x_2, YComponent=radius_6, ZComponent=0)  # -> Vector, Length
merge_2 = Merge(Data1=big_mountain.Geometry, Data2=rectangle_3.Rectangle)
move_8 = Move(Geometry=merge_2, Motion=vector_xyz_10.Vector)  # -> Geometry, Transform

# ---- group: Moon
amount_23 = Slider(8, range=0..20)
amount_24 = Slider(5.04, range=0..20)
amount_25 = Slider(5.84, range=0..20)
multiplication_4 = Multiplication(A=amount_23, B=amount_24)
circle = Circle(Plane=PlaneXY(0, 0, 0), Radius=amount_23)
multiplication_5 = Multiplication(A=amount_23, B=amount_25)
vector_xyz_11 = VectorXYZ(XComponent=multiplication_5, YComponent=multiplication_4, ZComponent=0)  # -> Vector, Length
amount_26 = Slider(13.565, range=0..50)
amount_27 = Slider(40.099, range=0..70)
moon = Move(Geometry=circle, Motion=vector_xyz_11.Vector)  # -> Geometry, Transform
amount_28 = Slider(50, range=0..70)
amount_29 = Slider(0, range=0..20)
rectangle_4 = Rectangle(Plane=PlaneXY(0, 0, 0), XSize=amount_26, YSize=amount_27, Radius=0)  # -> Rectangle, Length
amount_30 = Slider(0, range=0..20)
amount_31 = Slider(40.006, range=0..80)
amount_32 = Slider(6, range=0..120)
vector_xyz_12 = VectorXYZ(XComponent=amount_28, YComponent=amount_29, ZComponent=0)  # -> Vector, Length
move_9 = Move(Geometry=rectangle_4.Rectangle, Motion=vector_xyz_12.Vector)  # -> Geometry, Transform
multiplication_6 = Multiplication(A=amount_31, B=amount_32)
amount_33 = Slider(75, range=0..80)
amount_34 = Slider(4.06, range=0..70)
rectangle_5 = Rectangle(Plane=PlaneXY(0, 0, 0), XSize=multiplication_6, YSize=amount_30, Radius=0)  # -> Rectangle, Length
rectangle_6 = Rectangle(Plane=PlaneXY(0, 0, 0), XSize=amount_33, YSize=amount_34, Radius=0)  # -> Rectangle, Length
radius_7 = Slider(0, range=0..50)
unit_x_3 = UnitX(Factor=rectangle_5.Rectangle)
vector_xyz_13 = VectorXYZ(XComponent=unit_x_3, YComponent=radius_7, ZComponent=0)  # -> Vector, Length
merge_3 = Merge(Data1=moon.Geometry, Data2=move_9.Geometry, Data3=rectangle_6.Rectangle)
move_10 = Move(Geometry=merge_3, Motion=vector_xyz_13.Vector)  # -> Geometry, Transform

# ---- group: Bandit
radius_8 = Slider(0.798, range=0..50)
point_4 = Point([Point(57.28694556, 10.20938946, 0), Point(57.45562765, 10.7863821, 0), Point(57.68402057, 10.25747218, 0), Point(58.21293049, 10.2454515, 0), Point(58.34515797, 10.77218652, 0), Point(58.57137599, 10.23343082, 0)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])
amount_35 = Slider(-1.066, range=-10..20)
amount_36 = Slider(4.296, range=-5..20)
bandit_nurbs_curve = NurbsCurve(Vertices=point_4, Degree=radius_8, Periodic=False)  # -> Curve, Length, Domain
radius_9 = Slider(1.192, range=0..50)
vector_xyz_14 = VectorXYZ(XComponent=amount_36, YComponent=amount_35, ZComponent=0)  # -> Vector, Length
point_5 = Point([Point(48.19144543, 5.436260615, 0), Point(48.87235408, 7.08678318, 0), Point(48.78519777, 6.296929147, 0), Point(49.41708099, 7.271990333, 0), Point(49.68399718, 5.910173035, 0), Point(50.03262241, 6.770841567, 0)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])
bandit_move = Move(Geometry=bandit_nurbs_curve.Curve, Motion=vector_xyz_14.Vector)  # -> Geometry, Transform
length_3 = Slider(75, range=0..80)
length_4 = Slider(5.44, range=0..80)
grass_nurbs_curve = NurbsCurve(Vertices=point_5, Degree=radius_9, Periodic=False)  # -> Curve, Length, Domain
amount_37 = Slider(0, range=0..20)
amount_38 = Slider(40.006, range=0..80)
amount_39 = Slider(2, range=0..120)
rectangle_7 = Rectangle(Plane=PlaneXY(0, 0, 0), XSize=length_3, YSize=length_4, Radius=0)  # -> Rectangle, Length
multiplication_7 = Multiplication(A=amount_38, B=amount_39)
merge_4 = Merge(Data1=grass_nurbs_curve.Curve, Data2=bandit_move.Geometry, Data3=rectangle_7.Rectangle)
rectangle_8 = Rectangle(Plane=PlaneXY(0, 0, 0), XSize=multiplication_7, YSize=amount_37, Radius=0)  # -> Rectangle, Length
radius_10 = Slider(0, range=0..50)
unit_x_4 = UnitX(Factor=rectangle_8.Rectangle)
vector_xyz_15 = VectorXYZ(XComponent=unit_x_4, YComponent=radius_10, ZComponent=0)  # -> Vector, Length
move_11 = Move(Geometry=merge_4, Motion=vector_xyz_15.Vector)  # -> Geometry, Transform

# ---- group: background
height_2 = Slider(60, range=0..100)
width_2 = Slider(75, range=0..100)
background = Rectangle(Plane=PlaneXY(0, 0, 0), XSize=width_2, YSize=height_2, Radius=0)  # -> Rectangle, Length
merge_5 = Merge(Data1=background.Rectangle)
amount_40 = Slider(80, range=0..120)
amount_41 = Slider(8, range=0..70)
unit_x_5 = UnitX(Factor=amount_40)
linear_array_2 = LinearArray(Geometry=merge_5, Direction=unit_x_5, Count=amount_41)  # -> Geometry, Transform

# ---- group: Legs
amount_42 = Slider(0.3, range=0..80)
amount_43 = Slider(9, range=0..120)
amount_44 = Slider(2.5, range=0..80)
amount_45 = Slider(8, range=0..120)
rectangle_9 = Rectangle(Plane=PlaneXY(0, 0, 0), XSize=amount_42, YSize=amount_43, Radius=0)  # -> Rectangle, Length
amount_46 = Slider(15.6, range=0..300)
amount_47 = Slider(82, range=0..120)
amount_48 = Slider(86, range=0..120)
amount_49 = Slider(6.415, range=0..300)
rectangle_10 = Rectangle(Plane=PlaneXY(0, 0, 0), XSize=amount_44, YSize=amount_45, Radius=0)  # -> Rectangle, Length
rotate_2 = Rotate(Geometry=rectangle_9.Rectangle, Angle=1.570796327, Plane=PlaneXY(0, 0, 0))  # -> Geometry, Transform
vector_xyz_16 = VectorXYZ(XComponent=amount_49, YComponent=amount_48, ZComponent=0)  # -> Vector, Length
vector_xyz_17 = VectorXYZ(XComponent=amount_46, YComponent=amount_47, ZComponent=0)  # -> Vector, Length
rotate_3 = Rotate(Geometry=rectangle_10.Rectangle, Angle=1.570796327, Plane=PlaneXY(0, 0, 0))  # -> Geometry, Transform
amount_50 = Slider(15, range=0..80)
amount_51 = Slider(119, range=0..120)
amount_52 = Slider(20, range=0..120)
amount_53 = Slider(19, range=0..120)
amount_54 = Slider(80, range=0..120)
amount_55 = Slider(0, range=0..80)
move_12 = Move(Geometry=rotate_3.Geometry, Motion=vector_xyz_16.Vector)  # -> Geometry, Transform
move_13 = Move(Geometry=rotate_2.Geometry, Motion=vector_xyz_17.Vector)  # -> Geometry, Transform
rectangle_11 = Rectangle(Plane=PlaneXY(0, 0, 0), XSize=amount_50, YSize=amount_51, Radius=0)  # -> Rectangle, Length
vector_xyz_18 = VectorXYZ(XComponent=0, YComponent=amount_52, ZComponent=0)  # -> Vector, Length
vector_xyz_19 = VectorXYZ(XComponent=0, YComponent=amount_53, ZComponent=0)  # -> Vector, Length
vector_xyz_20 = VectorXYZ(XComponent=amount_55, YComponent=amount_54, ZComponent=0)  # -> Vector, Length
unit_y = UnitY(Factor=vector_xyz_18.Vector)
amount_56 = Slider(6, range=0..120)
unit_y_2 = UnitY(Factor=vector_xyz_19.Vector)
amount_57 = Slider(7, range=0..120)
move_14 = Move(Geometry=rectangle_11.Rectangle, Motion=vector_xyz_20.Vector)  # -> Geometry, Transform
linear_array_3 = LinearArray(Geometry=move_13.Geometry, Direction=unit_y_2, Count=amount_57)  # -> Geometry, Transform
linear_array_4 = LinearArray(Geometry=move_12.Geometry, Direction=unit_y, Count=amount_56)  # -> Geometry, Transform
merge_6 = Merge(Data1=move_14.Geometry, Data2=linear_array_3.Geometry, Data3=linear_array_4.Geometry)
amount_58 = Slider(20, range=0..120)
vector_xyz_21 = VectorXYZ(XComponent=0, YComponent=amount_58, ZComponent=0)  # -> Vector, Length
amount_59 = Slider(2, range=0..120)
unit_x_6 = UnitX(Factor=vector_xyz_21.Vector)
amount_60 = Slider(20, range=0..120)
linear_array_5 = LinearArray(Geometry=merge_6, Direction=unit_x_6, Count=amount_59)  # -> Geometry, Transform
vector_xyz_22 = VectorXYZ(XComponent=0, YComponent=amount_60, ZComponent=0)  # -> Vector, Length
geometry_2 = Geometry(<curve referenced from the Rhino model>)
unit_x_7 = UnitX(Factor=vector_xyz_22.Vector)
amount_61 = Slider(12, range=0..120)
linear_array_6 = LinearArray(Geometry=geometry_2, Direction=unit_x_7, Count=amount_61)  # -> Geometry, Transform

# ---- group: Smaller Mountains
radius_11 = Slider(50, range=0..50)
multiplication_8 = Multiplication(A=radius_11, B=Slider(0.47, range=0..1))
amount_62 = Slider(23, range=0..100)
vector_xyz_23 = VectorXYZ(XComponent=multiplication_8, YComponent=amount_62, ZComponent=0)  # -> Vector, Length
move_15 = Move(Geometry=rotate.Geometry, Motion=vector_xyz_23.Vector)  # -> Geometry, Transform
amount_63 = Slider(4, range=-5..20)
amount_64 = Slider(0.45, range=0..20)
amount_65 = Slider(15.2, range=0..20)
amount_66 = Slider(0.3, range=0..20)
amount_67 = Slider(19.8, range=0..20)
amount_68 = Slider(15.2, range=0..20)
amount_69 = Slider(75, range=0..80)
amount_70 = Slider(20.5, range=0..25)
scale_4 = Scale(Geometry=move_15.Geometry, Center=Point(0, 0, 0), Factor=amount_64)  # -> Geometry, Transform
vector_xyz_24 = VectorXYZ(XComponent=amount_63, YComponent=amount_65, ZComponent=0)  # -> Vector, Length
scale_5 = Scale(Geometry=move_15.Geometry, Center=Point(0, 0, 0), Factor=amount_66)  # -> Geometry, Transform
vector_xyz_25 = VectorXYZ(XComponent=amount_67, YComponent=amount_68, ZComponent=0)  # -> Vector, Length
mountain2_2 = Move(Geometry=scale_4.Geometry, Motion=vector_xyz_24.Vector)  # -> Geometry, Transform
small_mountain = Rectangle(Plane=PlaneXY(0, 0, 0), XSize=amount_69, YSize=amount_70, Radius=0)  # -> Rectangle, Length
mountain2_1_2 = Move(Geometry=scale_5.Geometry, Motion=vector_xyz_25.Vector)  # -> Geometry, Transform
merge_7 = Merge(Data1=mountain2_1_2.Geometry, Data2=mountain2_2.Geometry, Data3=small_mountain.Rectangle)
amount_71 = Slider(0, range=0..20)
amount_72 = Slider(40.006, range=0..80)
amount_73 = Slider(5, range=0..120)
multiplication_9 = Multiplication(A=amount_72, B=amount_73)
rectangle_12 = Rectangle(Plane=PlaneXY(0, 0, 0), XSize=multiplication_9, YSize=amount_71, Radius=0)  # -> Rectangle, Length
radius_12 = Slider(0, range=0..50)
unit_x_8 = UnitX(Factor=rectangle_12.Rectangle)
vector_xyz_26 = VectorXYZ(XComponent=unit_x_8, YComponent=radius_12, ZComponent=0)  # -> Vector, Length
move_16 = Move(Geometry=merge_7, Motion=vector_xyz_26.Vector)  # -> Geometry, Transform

# ---- group: Move Forest
amount_74 = Slider(0, range=0..20)
amount_75 = Slider(40.006, range=0..80)
amount_76 = Slider(3, range=0..120)
multiplication_10 = Multiplication(A=amount_75, B=amount_76)
rectangle_13 = Rectangle(Plane=PlaneXY(0, 0, 0), XSize=multiplication_10, YSize=amount_74, Radius=0)  # -> Rectangle, Length
radius_13 = Slider(0, range=0..50)
unit_x_9 = UnitX(Factor=rectangle_13.Rectangle)
vector_xyz_27 = VectorXYZ(XComponent=unit_x_9, YComponent=radius_13, ZComponent=0)  # -> Vector, Length
move_17 = Move(Geometry=merge, Motion=vector_xyz_27.Vector)  # -> Geometry, Transform

# ---- group: Back-up Tree line
point_6 = Point([Point(-0.02718541525, -70.04136, 0), Point(3.305998458, -58.70984735, 0), Point(10.73381535, -57.23846442, 0), Point(10.99777564, -57.23846442, 0), Point(12.73381535, -55.23846442, 0), Point(12.99777564, -55.23846442, 0)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])
nurbs_curve_3 = NurbsCurve(Vertices=point_6, Degree=Slider(0.8, range=-10..30), Periodic=False)  # -> Curve, Length, Domain

# ---- group: Extra
amount_77 = Slider(0.125, range=0..50)
amount_78 = Slider(3.55, range=0..20)
amount_79 = Slider(0, range=0..20)
amount_80 = Slider(2, range=0..50)
amount_81 = Slider(0, range=0..20)
rectangle_14 = Rectangle(Plane=PlaneXY(0, 0, 0), XSize=amount_77, YSize=amount_78, Radius=0)  # -> Rectangle, Length
amount_82 = Slider(72.5, range=0..80)
vector_xyz_28 = VectorXYZ(XComponent=amount_80, YComponent=amount_79, ZComponent=0)  # -> Vector, Length
vector_xyz_29 = VectorXYZ(XComponent=amount_82, YComponent=amount_81, ZComponent=0)  # -> Vector, Length
move_18 = Move(Geometry=rectangle_14.Rectangle, Motion=vector_xyz_28.Vector)  # -> Geometry, Transform
move_19 = Move(Geometry=rectangle_14.Rectangle, Motion=vector_xyz_29.Vector)  # -> Geometry, Transform
