# Grasshopper definition lamp.gh (Grasshopper 0.9.80)

# ---- group: Lampstand
cylinder = Cylinder(Base=PlaneXY(0, 0, 0), Radius=Slider(18.5, range=0..100), Length=Slider(98, range=0..1000))

# ---- group: Lampshade / Circle holes
vector_xyz = VectorXYZ(XComponent=Slider(50, range=0..1000), YComponent=Slider(485, range=0..1000), ZComponent=0)  # -> Vector, Length
circle = Circle(Plane=PlaneXY(0, 0, 0), Radius=Slider(1.7, range=0..100))
left_side = Move(Geometry=circle, Motion=vector_xyz.Vector)  # -> Geometry, Transform
vector_xyz_2 = VectorXYZ(XComponent=Slider(620, range=0..1000), YComponent=Slider(485, range=0..1000), ZComponent=0)  # -> Vector, Length
right_side = Move(Geometry=circle, Motion=vector_xyz_2.Vector)  # -> Geometry, Transform
merge = Merge(Data1=left_side.Geometry, Data2=right_side.Geometry)

# ---- group: Lampshade / Living Hinge Lampshade- Lasercut
ellipse = Ellipse(Plane=PlaneXY(0, 0, 0), Radius1=Slider(15, range=0..1000), Radius2=Slider(0.5, range=0..1000))  # -> Ellipse, Focus1, Focus2
unit_x = UnitX(Factor=1)
rotate = Rotate(Geometry=ellipse.Ellipse, Angle=1.570796327, Plane=unit_x)  # -> Geometry, Transform
vector_xyz_3 = VectorXYZ(XComponent=Slider(78, range=-40..1000), YComponent=Slider(-40, range=-40..1000), ZComponent=0)  # -> Vector, Length
vector_xyz_4 = VectorXYZ(XComponent=Slider(83, range=0..1000), YComponent=Slider(13, range=0..1000), ZComponent=0)  # -> Vector, Length
vector_xyz_5 = VectorXYZ(XComponent=Slider(83, range=0..1000), YComponent=Slider(-24, range=-40..1000), ZComponent=0)  # -> Vector, Length
vector_xyz_6 = VectorXYZ(XComponent=Slider(78, range=-40..1000), YComponent=0, ZComponent=0)  # -> Vector, Length
vector_xyz_7 = VectorXYZ(XComponent=Slider(78, range=-40..1000), YComponent=Slider(37, range=0..1000), ZComponent=0)  # -> Vector, Length
move = Move(Geometry=rotate.Geometry, Motion=vector_xyz_3.Vector)  # -> Geometry, Transform
move_2 = Move(Geometry=rotate.Geometry, Motion=vector_xyz_4.Vector)  # -> Geometry, Transform
move_3 = Move(Geometry=rotate.Geometry, Motion=vector_xyz_5.Vector)  # -> Geometry, Transform
move_4 = Move(Geometry=rotate.Geometry, Motion=vector_xyz_7.Vector)  # -> Geometry, Transform
move_5 = Move(Geometry=rotate.Geometry, Motion=vector_xyz_6.Vector)  # -> Geometry, Transform
merge_2 = Merge(Data1=move_3.Geometry, Data2=move_2.Geometry)
merge_3 = Merge(Data1=move.Geometry, Data2=move_5.Geometry, Data3=move_4.Geometry)
linear_array = LinearArray(Geometry=merge_2, Direction=Vector(10, 0, 0), Count=Slider(51, range=0..1000))  # -> Geometry, Transform
linear_array_2 = LinearArray(Geometry=merge_3, Direction=Vector(10, 0, 0), Count=Slider(52, range=0..1000))  # -> Geometry, Transform
vector_xyz_8 = VectorXYZ(XComponent=0, YComponent=Slider(485, range=0..1000), ZComponent=0)  # -> Vector, Length
vector_xyz_9 = VectorXYZ(XComponent=0, YComponent=Slider(485, range=0..1000), ZComponent=0)  # -> Vector, Length
move_6 = Move(Geometry=linear_array.Geometry, Motion=vector_xyz_8.Vector)  # -> Geometry, Transform
move_7 = Move(Geometry=linear_array_2.Geometry, Motion=vector_xyz_9.Vector)  # -> Geometry, Transform

# ---- group: Lampshade / Lampshade base ellipse
vector_xyz_10 = VectorXYZ(XComponent=Slider(334, range=0..1000), YComponent=0, ZComponent=0)  # -> Vector, Length
ellipse_2 = Ellipse(Plane=PlaneXY(0, 0, 0), Radius1=Slider(325, range=0..1000), Radius2=Slider(38, range=0..1000))  # -> Ellipse, Focus1, Focus2
move_8 = Move(Geometry=ellipse_2.Ellipse, Motion=vector_xyz_10.Vector)  # -> Geometry, Transform
vector_xyz_11 = VectorXYZ(XComponent=0, YComponent=Slider(485, range=0..1000), ZComponent=0)  # -> Vector, Length
move_9 = Move(Geometry=move_8.Geometry, Motion=vector_xyz_11.Vector)  # -> Geometry, Transform

# ---- group: Lamp Base Bottom
vector_xyz_12 = VectorXYZ(XComponent=0, YComponent=0, ZComponent=Slider(10, range=0..1000))  # -> Vector, Length
circle_2 = Circle(Plane=PlaneXY(0, 0, 0), Radius=Slider(20.8, range=0..100))
cylinder_2 = Cylinder(Base=PlaneXY(0, 0, 0), Radius=Slider(20.8, range=0..100), Length=Slider(10, range=0..1000))
vector_xyz_13 = VectorXYZ(XComponent=0, YComponent=0, ZComponent=Slider(7, range=0..1000))  # -> Vector, Length
move_10 = Move(Geometry=circle_2, Motion=vector_xyz_12.Vector)  # -> Geometry, Transform
circle_3 = Circle(Plane=PlaneXY(0, 0, 0), Radius=Slider(85.023, range=0..1000))
move_11 = Move(Geometry=cylinder_2, Motion=vector_xyz_13.Vector)  # -> Geometry, Transform
merge_4 = Merge(Data1=move_10.Geometry, Data2=circle_3)
loft = Loft(Curves=merge_4, Options={Adjust=False, Closed=False, LoftEnds=0, LoftSimp=0, LoftType=0, Rebuild=10, Refit=0.01})

# ---- group: Lampshade Connector
number_slider = Slider(100, range=0..300)
number_slider_2 = Slider(2, range=0..100)
cylinder_3 = Cylinder(Base=PlaneXY(0, 0, 0), Radius=Slider(18.5, range=0..100), Length=Slider(5, range=0..100))
unit_x_2 = UnitX(Factor=1)
cylinder_4 = Cylinder(Base=PlaneXY(0, 0, 0), Radius=Slider(1.5, range=0..100), Length=number_slider)
vector_xyz_14 = VectorXYZ(XComponent=0, YComponent=number_slider, ZComponent=number_slider_2)  # -> Vector, Length
rotate_3d = Rotate3D(Geometry=cylinder_4, Angle=1.570796327, Center=Point(0, 0, 0), Axis=unit_x_2)  # -> Geometry, Transform
vector_xyz_15 = VectorXYZ(XComponent=0, YComponent=0, ZComponent=Slider(0, range=0..100))  # -> Vector, Length
move_12 = Move(Geometry=cylinder_3, Motion=vector_xyz_15.Vector)  # -> Geometry, Transform
move_13 = Move(Geometry=rotate_3d.Geometry, Motion=vector_xyz_14.Vector)  # -> Geometry, Transform
duplicate_data = DuplicateData(Data=rotate_3d.Geometry, Number=2, Order=True)
vector_xyz_16 = VectorXYZ(XComponent=0, YComponent=0, ZComponent=number_slider_2)  # -> Vector, Length
move_14 = Move(Geometry=duplicate_data, Motion=vector_xyz_16.Vector)  # -> Geometry, Transform
merge_5 = Merge(Data1=move_12.Geometry, Data2=move_14.Geometry, Data3=move_13.Geometry)

# ---- group: Didn't Use / Base top
number_slider_3 = Slider(100, range=0..1000)
addition = Addition(A=Slider(74, range=0..100), B=number_slider_3)
vector_xyz_17 = VectorXYZ(XComponent=0, YComponent=0, ZComponent=number_slider_3)  # -> Vector, Length
circle_4 = Circle(Plane=PlaneXY(0, 0, 0), Radius=Slider(14, range=0..100))
vector_xyz_18 = VectorXYZ(XComponent=0, YComponent=0, ZComponent=addition)  # -> Vector, Length
circle_5 = Circle(Plane=PlaneXY(0, 0, 0), Radius=Slider(17.2, range=0..100))
move_15 = Move(Geometry=circle_4, Motion=vector_xyz_17.Vector)  # -> Geometry, Transform
move_16 = Move(Geometry=circle_5, Motion=vector_xyz_18.Vector)  # -> Geometry, Transform
merge_6 = Merge(Data1=move_16.Geometry, Data2=move_15.Geometry)
loft_2 = Loft(Curves=merge_6, Options={Adjust=False, Closed=False, LoftEnds=0, LoftSimp=0, LoftType=0, Rebuild=10, Refit=0.01})

# ---- group: Didn't Use
number_slider_4 = Slider(4, range=0..100)

# ---- group: Didn't Use / Caps
vector_xyz_19 = VectorXYZ(XComponent=Slider(8.181, range=0..100), YComponent=0, ZComponent=0)  # -> Vector, Length
cylinder_5 = Cylinder(Base=PlaneXY(0, 0, 0), Radius=Slider(2, range=0..100), Length=Slider(5, range=0..100))
cylinder_6 = Cylinder(Base=PlaneXY(0, 0, 0), Radius=Slider(2, range=0..100), Length=Slider(2, range=0..100))
vector_xyz_20 = VectorXYZ(XComponent=Slider(8.181, range=0..100), YComponent=0, ZComponent=number_slider_4)  # -> Vector, Length
move_17 = Move(Geometry=cylinder_6, Motion=vector_xyz_20.Vector)  # -> Geometry, Transform
move_18 = Move(Geometry=cylinder_5, Motion=vector_xyz_19.Vector)  # -> Geometry, Transform

# ---- group: Didn't Use
cylinder_7 = Cylinder(Base=PlaneXY(0, 0, 0), Radius=Slider(18.5, range=0..100), Length=Slider(5, range=0..1000))
vector_xyz_21 = VectorXYZ(XComponent=0, YComponent=0, ZComponent=Slider(98, range=0..1000))  # -> Vector, Length
move_19 = Move(Geometry=cylinder_7, Motion=vector_xyz_21.Vector)  # -> Geometry, Transform
