# Grasshopper definition icecream.gh (Grasshopper 0.9.80)

# ---- group: Ferris Wheel
polygon = Polygon(
    Plane=PlaneXY(0, 0, 0),
    Radius=Slider(85, range=0..400),
    Segments=Slider(3, range=0..400),
    FilletRadius=Slider(4, range=0..400))  # -> Polygon, Length
unit_y = UnitY(Factor=Slider(89.903, range=0..400))
move = Move(Geometry=polygon.Polygon, Motion=unit_y)  # -> Geometry, Transform
unit_x = UnitX(Factor=Slider(51.477, range=0..400))
move_2 = Move(Geometry=move.Geometry, Motion=unit_x)  # -> Geometry, Transform
point = Point(Point(0, 0, 0))
circle = Circle(Plane=PlaneXY(0, 0, 0), Radius=Slider(3.3, range=0..400))
unit_y_2 = UnitY(Factor=Slider(162.364, range=0..400))
rotate = Rotate(Geometry=move_2.Geometry, Angle=Slider(0.53, range=0..400), Plane=point)  # -> Geometry, Transform
move_3 = Move(Geometry=circle, Motion=unit_y_2)  # -> Geometry, Transform
polar_array = PolarArray(Geometry=rotate.Geometry, Plane=PlaneXY(0, 0, 0), Count=Slider(5, range=0..400), Angle=6.283185307)  # -> Geometry, Transform
circle_2 = Circle(Plane=PlaneXY(0, 0, 0), Radius=Slider(180, range=0..400))
polar_array_2 = PolarArray(Geometry=move_3.Geometry, Plane=PlaneXY(0, 0, 0), Count=Slider(5, range=0..400), Angle=6.283185307)  # -> Geometry, Transform
merge = Merge(Data1=circle_2, Data2=polar_array_2.Geometry, Data3=polar_array.Geometry)

# ---- group: Stand
polygon_2 = Polygon(
    Plane=PlaneXY(0, 0, 0),
    Radius=Slider(230, range=0..400),
    Segments=Slider(3, range=0..400),
    FilletRadius=Slider(4, range=0..400))  # -> Polygon, Length
unit_y_3 = UnitY(Factor=Slider(112, range=-300..400))
circle_3 = Circle(Plane=PlaneXY(0, 0, 0), Radius=Slider(3.3, range=0..400))
unit_y_4 = UnitY(Factor=Slider(108.519, range=0..400))
move_4 = Move(Geometry=polygon_2.Polygon, Motion=unit_y_3)  # -> Geometry, Transform
move_5 = Move(Geometry=circle_3, Motion=unit_y_4)  # -> Geometry, Transform
unit_x_2 = UnitX(Factor=Slider(379.477, range=0..400))
unit_x_3 = UnitX(Factor=Slider(384.148, range=0..400))
move_6 = Move(Geometry=move_4.Geometry, Motion=unit_x_2)  # -> Geometry, Transform
point_2 = Point(Point(0, 0, 0))
move_7 = Move(Geometry=move_5.Geometry, Motion=unit_x_3)  # -> Geometry, Transform
rotate_2 = Rotate(Geometry=move_6.Geometry, Angle=Slider(-0.525, range=-100..400), Plane=point_2)  # -> Geometry, Transform
merge_2 = Merge(Data1=rotate_2.Geometry, Data2=move_7.Geometry)

# ---- group: Side of booth
change_this_based_on_material_thickness = Slider(5.7, range=0..400)
change_this_based_on_material_thickness_2 = Slider(5.7, range=0..400)
rectangle = Rectangle(Plane=PlaneXY(0, 0, 0), XSize=change_this_based_on_material_thickness, YSize=Slider(2.721, range=0..400), Radius=0)  # -> Rectangle, Length
rectangle_2 = Rectangle(Plane=PlaneXY(0, 0, 0), XSize=change_this_based_on_material_thickness_2, YSize=Slider(2.721, range=0..400), Radius=0)  # -> Rectangle, Length
unit_y_5 = UnitY(Factor=Slider(2.4, range=0..400))
rectangle_3 = Rectangle(Plane=PlaneXY(0, 0, 0), XSize=Slider(20, range=0..400), YSize=Slider(36, range=0..400), Radius=0)  # -> Rectangle, Length
unit_y_6 = UnitY(Factor=Slider(40.7, range=0..400))
unit_y_7 = UnitY(Factor=Slider(4.94, range=0..400))
move_8 = Move(Geometry=rectangle.Rectangle, Motion=unit_y_5)  # -> Geometry, Transform
move_9 = Move(Geometry=rectangle_2.Rectangle, Motion=unit_y_6)  # -> Geometry, Transform
notch_a_match = UnitX(Factor=Slider(1.765, range=0..400))
notch_a_match_2 = UnitX(Factor=Slider(1.765, range=0..400))
rectangle_4 = Rectangle(Plane=PlaneXY(0, 0, 0), XSize=Slider(30, range=0..400), YSize=Slider(46, range=0..400), Radius=0)  # -> Rectangle, Length
move_10 = Move(Geometry=rectangle_3.Rectangle, Motion=unit_y_7)  # -> Geometry, Transform
move_11 = Move(Geometry=move_8.Geometry, Motion=notch_a_match)  # -> Geometry, Transform
move_12 = Move(Geometry=move_9.Geometry, Motion=notch_a_match_2)  # -> Geometry, Transform
merge_3 = Merge(Data1=rectangle_4.Rectangle, Data2=move_10.Geometry, Data3=move_11.Geometry, Data4=move_12.Geometry)
unit_x_4 = UnitX(Factor=Slider(228.166, range=0..400))
move_13 = Move(Geometry=merge_3, Motion=unit_x_4)  # -> Geometry, Transform

# ---- group: Stand- Hole
polygon_3 = Polygon(
    Plane=PlaneXY(0, 0, 0),
    Radius=Slider(144.912, range=0..400),
    Segments=Slider(3, range=0..400),
    FilletRadius=Slider(4, range=0..400))  # -> Polygon, Length
unit_y_8 = UnitY(Factor=Slider(112, range=-300..400))
move_14 = Move(Geometry=polygon_3.Polygon, Motion=unit_y_8)  # -> Geometry, Transform
unit_x_5 = UnitX(Factor=Slider(379.477, range=0..400))
move_15 = Move(Geometry=move_14.Geometry, Motion=unit_x_5)  # -> Geometry, Transform
point_3 = Point(Point(0, 0, 0))
rotate_3 = Rotate(Geometry=move_15.Geometry, Angle=Slider(-0.525, range=-100..400), Plane=point_3)  # -> Geometry, Transform
